# Dynamo graph Delete Unused Filters.dyn (Dynamo 2.19.3.6394)
# author: gabas01
# This script cleans the project by deleting unused View Filters.
# packages: Clockwork for Dynamo 3.x 3.3.0, Data-Shapes 2025.3.119

# group: Collecting Unused Filters
python_script = Python()  # CPython3; unwired: IN[0]
# ---------- python_script.python (34 lines) ----------
# Imports the necessary libraries from Revit and Dynamo
import clr
clr.AddReference('RevitAPI')
from Autodesk.Revit.DB import *

clr.AddReference('RevitServices')
from RevitServices.Persistence import DocumentManager

# Gets the current Revit document
doc = DocumentManager.Instance.CurrentDBDocument

# --- 1. Get ALL view filters from the project ---
all_filters = FilteredElementCollector(doc).OfClass(ParameterFilterElement).ToElements()
all_filter_ids = {f.Id: f for f in all_filters}

# --- 2. Get the IDs of all filters USED in View Templates ---
views = FilteredElementCollector(doc).OfClass(View).ToElements()
used_filter_ids = set() # Using a "set" to avoid duplicates

for view in views:
    if view.IsTemplate:
        filter_ids_on_template = view.GetFilters()
        if filter_ids_on_template:
            for fid in filter_ids_on_template:
                used_filter_ids.add(fid)

# --- 3. Compare to find the UNUSED filters ---
unused_filters = []
for filter_id, filter_element in all_filter_ids.items():
    if filter_id not in used_filter_ids:
        unused_filters.append(filter_element)

# The node's output will be the list of unused filter elements
OUT = unused_filters
# ----------------------------------------

# group: Create Selection Interface
string = StringInput("Select the unused filters you want to delete")
string_2 = StringInput("Delete Selected")
string_3 = StringInput("Filters")
name = Custom[Element.Name+](element=python_script)  # package Clockwork for Dynamo 3.x; Gets an element's name. Unlike the OOTB node, this node should work for *all* Revit elements that have names and will also return the localized names of system parameters, parameter groups, display unit types, parameter types, unit symbol types, unit types and ForgeTypeIds.
number = DoubleInput(400)
listview_data = Custom[Listview Data](InputName=string_3, Keys=name, Values=python_script, Height_optionnal=number)  # package Data-Shapes; Create data for ListView input in UI.MultiInputForm ++ . Check out www.data-shapes.net for more infos.
boolean = BoolSelector(true)
string_4 = StringInput("Cancel")
number_2 = DoubleInput(500)
multipleinputform = Custom[MultipleInputForm ++](Description_optional=string, ButtonText_optional=string_2, Inputs=listview_data, Toggle=boolean, CancelButtonText_optional=string_4, Width_optional=number_2)  # package Data-Shapes; Create a form with multiple inputs. see www.data-shapes.net for tutorials and infos!

# group: Execute the Deletion
code_block = CodeBlock { []; }
firstItem = List.FirstItem(list=multipleinputform.User_Inputs)
if_ = RefactoredIf(test=multipleinputform.Was_Cancelled, true=code_block, false=firstItem)
delete = Element.Delete(element=if_)
string_5 = StringInput("No filters were deleted")
string_6 = StringInput("Selected filters have been successfully deleted")
if_2 = RefactoredIf(test=multipleinputform.Was_Cancelled, true=string_5, false=string_6)
watch = Watch(if_2)  # graph output
python_script_2 = Python(IN[0]=if_2)  # CPython3
# ---------- python_script_2.python (10 lines) ----------
import clr
clr.AddReference('RevitAPIUI')
from Autodesk.Revit.UI import TaskDialog

# Get the message from the node's input
message = IN[0]

# Show the dialog box only if a message was provided
if message:
    TaskDialog.Show("Operation Status", message)
# ----------------------------------------
